# Grasshopper definition Deer.gh (Grasshopper 1.0.7)

# ----
# Output breps and
# original height data
# from osm
tpe_101 = FilePath("/Users/zoeyzhao/Documents/PhD/portfolio/behance/osm/osm tw/taipei tw map.osm")
osm_breps_heights = GhPythonScript(osm=tpe_101)  # -> heights, breps, meta
# ---------- osm_breps_heights: Python ----------
"""Provides a scripting component.
    Inputs:
        osm: from osm file
    Output:
        heights: buildings height.
        breps: key building breps.
        meta: additional information from osm, key to identify ways.
        """

__author__ = "dpwinter & zoeyYhChao"

import rhinoscriptsyntax as rs
import xml.etree.ElementTree as ET
import ghpythonlib.treehelpers as th
import random
import math
import os
import Rhino 

####
# TODO: extract meta data and output in list.
####
 

R = 6367000 # radius of earth in meters
m_per_storey = 3

def latlon2xy(lat, lon, dx, dy, min_lat, min_lon):
    x = (lon - min_lon) * dx
    y = (lat - min_lat) * dy
    return x, y

def coord2pt(coord):
    return Rhino.Geometry.Point3d(coord[0], coord[1], 0)

def pts2srf(pts):
    if len(pts) <= 2: 
        return None # Can only build surface from at least 3 pts.
    if pts[0] != pts[-1]: # close pts if not done already 
        pts.append(pts[0])
    crv = rs.AddPolyline(pts)
    if rs.ClosedCurveOrientation(crv) == -1:
        rs.ReverseCurve(crv)
    return rs.AddPlanarSrf(crv)[0]
    
def srfdiff(isrfs, osrfs):
    if len(isrfs) == 0 and len(osrfs) == 1:
        return osrfs[0]
    elif len(isrfs) == 1 and len(osrfs) == 0:
        return isrfs[0]
    elif len(isrfs) > 1 and len(osrfs) == 0:
        return rs.BooleanUnion(isrfs)[0]
    elif len(isrfs) == 0 and len(osrfs) > 1:
        return rs.BooleanUnion(osrfs)[0]
    elif len(isrfs) > 0 and len(osrfs) > 0:
        return rs.BooleanDifference(osrfs, isrfs)[0]
    else:
        raise Exception('jo')

tree = ET.parse(osm)
root = tree.getroot()

# 1. Find area min/max lat/lon bounds
bounds = root.find("bounds")
min_lat, max_lat = float(bounds.attrib['minlat']), float(bounds.attrib['maxlat'])
min_lon, max_lon = float(bounds.attrib['minlon']), float(bounds.attrib['maxlon'])

# 2. Find lat/lon area extension
delta_lat = max_lat - min_lat
delta_lon = max_lon - min_lon

# 3. Convert from lat/lon to Cartesian space (x,y)
mid_lat = min_lat + delta_lat / 2
dy = math.pi / 180 * R
dx = dy * math.cos( math.radians( mid_lat ) )

# 4. Find all lat/lon coordinates and convert to x,y
node_coord_dict = dict()
for node_tag in root.findall("node"):
    node_id = node_tag.attrib['id']
    lat = float(node_tag.attrib['lat'])
    lon = float(node_tag.attrib['lon'])
    x,y = latlon2xy(lat, lon, dx, dy, min_lat, min_lon)
    node_coord_dict[node_id] = (x,y)

def pts_from_way(way):
    pts = []
    for nd in way.findall("nd"):
        node_id = nd.attrib['ref']
        coord = node_coord_dict[node_id]
        pt = coord2pt(coord)
        pts.append(pt)
    return pts
    
def extract_height(node):
    lvl = node.find("tag/[@k='building:levels']")
    if lvl is not None: 
        a = lvl.attrib['v']
        return round(float(lvl.attrib['v'])) * m_per_storey
    else: return None
    
# Things to keep track of 
heights = []
breps = []
meta = []

# 5. Parse relations, create brep, track
for relation in root.findall('relation'):
    if relation.find("tag[@k='building']") is not None:
        isrfs, osrfs = [], []

        for member in relation.findall("member[@type='way']"):
            way_id, role = member.attrib['ref'], member.attrib['role']
            way = root.find("way[@id='%s']" % way_id)
            if way:
                pts = pts_from_way(way)
                srf = pts2srf(pts)
                if srf:
                    if role == 'inner' or role == 'part': 
                        isrfs.append(srf)
                    if role == 'outer' or role == 'outline': 
                        osrfs.append(srf)
        
        brep = srfdiff(isrfs,osrfs)
        breps.append(brep)
        
        heights.append(extract_height(relation))
        
        relation_meta = []
        for tag in relation.findall('tag'):
            tag_str = ":".join([tag.attrib['k'],tag.attrib['v']])
            relation_meta.append(tag_str)
        meta.append(relation_meta)


# process all ways
for way in root.findall('way'):
    if way.find("tag[@k='building']") is not None:

        pts = pts_from_way(way)
        brep = pts2srf(pts)
        breps.append(brep)

        heights.append(extract_height(way))
        
        way_meta = []
        for tag in way.findall('tag'):
            tag_str = ":".join([tag.attrib['k'],tag.attrib['v']])
            way_meta.append(tag_str)
        meta.append(way_meta)

breps = th.list_to_tree(breps)
heights = th.list_to_tree(heights)
meta = th.list_to_tree(meta)

#random height for no height buildings
#overlapping buildings > boolean
# ---------- end osm_breps_heights ----------

madrid_centre = FilePath("/Users/zoeyzhao/Documents/PhD/portfolio/behance/osm/madrid.osm")
maximum_storey_number = Slider(10, range=0..10)
minimum_storey_number = Slider(2, range=0..10)
storey_height_meter = Slider(3, range=0..10)

# ----
# Output breps
# in 2D
osm_breps_heights_2 = GhPythonScript(osm=tpe_101)  # -> heights, breps, meta; same code as osm_breps_heights
green = GhPythonScript(osm=tpe_101)  # -> leisure, natural
# ---------- green: Python ----------
"""Provides a scripting component.
    Inputs:
        osm: from osm file
    Output:
        leisure: output breps of leisure
        natural: output breps of natural
        """

__author__ = "zoeychao"

import rhinoscriptsyntax as rs
import xml.etree.ElementTree as ET
import ghpythonlib.treehelpers as th
import random
import math
import os
import Rhino 

####
# TODO: extract meta data and output in list.
####
 

R = 6367000 # radius of earth in meters

def latlon2xy(lat, lon, dx, dy, min_lat, min_lon):
    x = (lon - min_lon) * dx
    y = (lat - min_lat) * dy
    return x, y

def coord2pt(coord):
    return Rhino.Geometry.Point3d(coord[0], coord[1], 0)

def pts2srf(pts):
    if len(pts) <= 2: 
        return None # Can only build surface from at least 3 pts.
    if pts[0] != pts[-1]: # close pts if not done already 
        pts.append(pts[0])
    crv = rs.AddPolyline(pts)
    if rs.ClosedCurveOrientation(crv) == -1:
        rs.ReverseCurve(crv)
    return rs.AddPlanarSrf(crv)[0]
    
def srfdiff(isrfs, osrfs):
    if len(isrfs) == 0 and len(osrfs) == 1:
        return osrfs[0]
    elif len(isrfs) == 1 and len(osrfs) == 0:
        return isrfs[0]
    elif len(isrfs) > 1 and len(osrfs) == 0:
        return rs.BooleanUnion(isrfs)[0]
    elif len(isrfs) == 0 and len(osrfs) > 1:
        return rs.BooleanUnion(osrfs)[0]
    elif len(isrfs) > 0 and len(osrfs) > 0:
        return rs.BooleanDifference(osrfs, isrfs)[0]
    elif len(isrfs) == 0 and len(osrfs) == 0:
        return None

tree = ET.parse(osm)
root = tree.getroot()

# 1. Find area min/max lat/lon bounds
bounds = root.find("bounds")
min_lat, max_lat = float(bounds.attrib['minlat']), float(bounds.attrib['maxlat'])
min_lon, max_lon = float(bounds.attrib['minlon']), float(bounds.attrib['maxlon'])

# 2. Find lat/lon area extension
delta_lat = max_lat - min_lat
delta_lon = max_lon - min_lon

# 3. Convert from lat/lon to Cartesian space (x,y)
mid_lat = min_lat + delta_lat / 2
dy = math.pi / 180 * R
dx = dy * math.cos( math.radians( mid_lat ) )

# 4. Find all lat/lon coordinates and convert to x,y
node_coord_dict = dict()
for node_tag in root.findall("node"):
    node_id = node_tag.attrib['id']
    lat = float(node_tag.attrib['lat'])
    lon = float(node_tag.attrib['lon'])
    x,y = latlon2xy(lat, lon, dx, dy, min_lat, min_lon)
    node_coord_dict[node_id] = (x,y)

def pts_from_way(way):
    pts = []
    for nd in way.findall("nd"):
        node_id = nd.attrib['ref']
        coord = node_coord_dict[node_id]
        pt = coord2pt(coord)
        pts.append(pt)
    return pts
    
# Things to keep track of 
leisure = []
natural = []

# 5. Parse relations, create brep, track
for relation in root.findall('relation'):
    if relation.find("tag[@k='leisure']") is not None:
        isrfs, osrfs = [], []

        for member in relation.findall("member[@type='way']"):
            way_id, role = member.attrib['ref'], member.attrib['role']
            way = root.find("way[@id='%s']" % way_id)
            if way:
                pts = pts_from_way(way)
                srf = pts2srf(pts)
                if srf:
                    if role == 'inner' or role == 'part': 
                        isrfs.append(srf)
                    if role == 'outer' or role == 'outline': 
                        osrfs.append(srf)
        
        brep = srfdiff(isrfs,osrfs)
        leisure.append(brep)
        
for relation in root.findall('relation'):
    if relation.find("tag[@k='natural']") is not None:
        isrfs, osrfs = [], []

        for member in relation.findall("member[@type='way']"):
            way_id, role = member.attrib['ref'], member.attrib['role']
            way = root.find("way[@id='%s']" % way_id)
            if way:
                pts = pts_from_way(way)
                srf = pts2srf(pts)
                if srf:
                    if role == 'inner' or role == 'part': 
                        isrfs.append(srf)
                    if role == 'outer' or role == 'outline': 
                        osrfs.append(srf)
        
        brep = srfdiff(isrfs,osrfs)
        natural.append(brep)
 
# process all ways
for way in root.findall('way'):
    #if way.find("tag[@k='leisure']") is not None:
    if way.find("tag[@k='water*']") is not None:

        pts = pts_from_way(way)
        brep = pts2srf(pts)
        leisure.append(brep)

for way in root.findall('way'):
    if way.find("tag[@k='natural']") is not None:

        pts = pts_from_way(way)
        brep = pts2srf(pts)
        natural.append(brep)

leisure = th.list_to_tree(leisure)
natural = th.list_to_tree(natural)
# ---------- end green ----------

# ----
# Output waterway
# as points
# Waterway is just a practice to outputs points
# with GHPython. The future additional plugins
# will be focus on only output breps.
waterway = GhPythonScript(osm=madrid_centre)  # -> water
# ---------- waterway: Python ----------
"""Provides a scripting component.
    Inputs:
        osm: from osm file
    Output:
        water: outputs the waterway points.
        """

__author__ = "zoeychao"

import rhinoscriptsyntax as rs
import xml.etree.ElementTree as ET
import ghpythonlib.treehelpers as th
import random
import math
import os
import Rhino 

####
# TODO: extract meta data and output in list.
####
 

R = 6367000 # radius of earth in meters

def latlon2xy(lat, lon, dx, dy, min_lat, min_lon):
    x = (lon - min_lon) * dx
    y = (lat - min_lat) * dy
    return x, y

def coord2pt(coord):
    return Rhino.Geometry.Point3d(coord[0], coord[1], 0)

#def pts2srf(pts):
#    if len(pts) <= 2: 
#        return None # Can only build surface from at least 3 pts.
#    if pts[0] != pts[-1]: # close pts if not done already 
#        pts.append(pts[0])
#    crv = rs.AddPolyline(pts)
#    if rs.ClosedCurveOrientation(crv) == -1:
#        rs.ReverseCurve(crv)
#    return rs.AddPlanarSrf(crv)[0]
    
#def srfdiff(isrfs, osrfs):
#    if len(isrfs) == 0 and len(osrfs) == 1:
#        return osrfs[0]
#    elif len(isrfs) == 1 and len(osrfs) == 0:
#        return isrfs[0]
#    elif len(isrfs) > 1 and len(osrfs) == 0:
#        return rs.BooleanUnion(isrfs)[0]
#    elif len(isrfs) == 0 and len(osrfs) > 1:
#        return rs.BooleanUnion(osrfs)[0]
#    elif len(isrfs) > 0 and len(osrfs) > 0:
#        return rs.BooleanDifference(osrfs, isrfs)[0]
#    elif len(isrfs) == 0 and len(osrfs) == 0:
#        return None

tree = ET.parse(osm)
root = tree.getroot()

# 1. Find area min/max lat/lon bounds
bounds = root.find("bounds")
min_lat, max_lat = float(bounds.attrib['minlat']), float(bounds.attrib['maxlat'])
min_lon, max_lon = float(bounds.attrib['minlon']), float(bounds.attrib['maxlon'])

# 2. Find lat/lon area extension
delta_lat = max_lat - min_lat
delta_lon = max_lon - min_lon

# 3. Convert from lat/lon to Cartesian space (x,y)
mid_lat = min_lat + delta_lat / 2
dy = math.pi / 180 * R
dx = dy * math.cos( math.radians( mid_lat ) )

# 4. Find all lat/lon coordinates and convert to x,y
node_coord_dict = dict()
for node_tag in root.findall("node"):
    node_id = node_tag.attrib['id']
    lat = float(node_tag.attrib['lat'])
    lon = float(node_tag.attrib['lon'])
    x,y = latlon2xy(lat, lon, dx, dy, min_lat, min_lon)
    node_coord_dict[node_id] = rs.CreatePoint(x,y,0)

def pts_from_way(way):
    pts = []
    for nd in way.findall("nd"):
        node_id = nd.attrib['ref']
        coord = node_coord_dict[node_id]
        pt = coord2pt(coord)
        pts.append(pt)
    return pts
    
# Things to keep track of 
water = []

# 5. Find related ways
related_way_ids = set()
for relation in root.findall('relation'):
    if relation.find("tag[@k='waterway']") is not None:
        for member in relation.findall("member[@type='way']"):
            way_ref = member.attrib['ref']
            related_way_ids.add(way_ref)

# 6. Process all ways
for way in root.findall('way'):
    if way.find("tag[@k='waterway']") is not None or way.find("tag[@k='water']") is not None or way.find("tag[@k='natural'][@v='water']") is not None or way.attrib['id'] in related_way_ids:

        coord_list = []
        for nd in way.findall("nd"):
            node_id = nd.attrib['ref']
            coord_list.append(node_coord_dict[node_id])
            

        water.append(coord_list)
        #print(way.attrib['id'])
        
        
# convert list to treeee
water = th.list_to_tree(water)
# ---------- end waterway ----------

natural_breps = Brep(green.natural)
building_breps = Brep(osm_breps_heights_2.breps)
meta_original_as_feature_key_from_osm_da = Panel(osm_breps_heights.meta)  # "Meta: original as 'Feature Key' from osm data"
random_heights = GhPythonScript(
    List=osm_breps_heights.heights,
    MPStorey=storey_height_meter,
    MINStoreys=minimum_storey_number,
    MAXStoreys=maximum_storey_number)  # -> Heights; inputs List: list
# ---------- random_heights: Python ----------
"""Provides a scripting component.
    Inputs:
        List: The list of heights data from osm
        MPStorey: meters per storey
        MINStoreys: minimum number of storey
        MAXStoreys: maximum number of storey
    Output:
        Heights: Create random heights for null."""
        
__author__ = "zoeyYhChao"

#Random Heights Generator

import rhinoscriptsyntax as rs
import xml.etree.ElementTree as ET
import ghpythonlib.treehelpers as th
import random
import math

def height():
    
    def MPStorey(meters):
        for mps in range(meters):
            print MINStoreys(meters)
                
    def MINStoreys(minimum):
        for mins in range(minimum):
            print MAXStoreys(minimum)
                
    def MAXStoreys(maximum):
        for maxs in range(maximum):
            print()
            
height()

for i in range (len(List)):
    if List[i] == None:
        List[i] = random.randrange(MPStorey * MINStoreys, MPStorey * MAXStoreys + 1)


Heights = th.list_to_tree(List)
# ---------- end random_heights ----------
original_heights_from_osm = Panel(osm_breps_heights.heights)
point = Point(simplify(waterway))
leisure_breps = Brep(green.leisure)
polyline = PolyLine(Vertices=point, Closed=False)
unit_z = UnitZ(Factor=random_heights)
original_heights_from_osm_random_for_nul = Panel(random_heights)  # "original heights from osm + random for null"
water_crvs = Curve(polyline)

# ----
# Create map into 3D
extrude = Extrude(Base=osm_breps_heights.breps, Direction=unit_z)  # -> simplify(Extrusion)
